# Grasshopper definition 01_LA_Hardscape and Drainage Graphics A.gh (Grasshopper 0.9.76)
# plug-ins: Python Interpreter

# ---- group: stripe width - connected to print size
number_slider = Slider(1, range=0..10)  # disabled

# ----
panel = Panel("""drainareamesh
hardscapemesh
draincurves
drainpoint
fullterrainmesh
groundsurface
hardgrid
groundsurface
hardgrid
parcels
pathdestpoint
pathsourcepoints
pathways
plantgrid
siteoutline
terrainmesh
terrainmeshlines""")
number_slider_2 = Slider(4, range=0..100)

# ---- group: stripe size factor
number_slider_3 = Slider(0.5, range=0..1)  # disabled

# ----
panel_2 = Panel("F:\Local Code\Work\Local Code - Los Angeles\06 DB\")
number_slider_4 = Slider(3, range=0..10)  # disabled
site_number = Slider(424, range=1..766)
neg = Negative(Value=number_slider)  # disabled
division = Division(A=number_slider, B=number_slider_4)  # disabled
neg_2 = Negative(Value=division)  # disabled
item = ListItem(List=panel, Index=number_slider_2, Wrap=True)
toggle = BooleanToggle(True)
import_geojson = ImportGeoJSON(Import=toggle, geoJSONFolderPath="F:\Local Code\Work\Local Code - Los Angeles\02 geoJSON\", SiteNumber=site_number)  # -> out, Geometry, Attributes, Values, LayerNames; inputs Import: Boolean, SiteNumber: Int32
# ---------- import_geojson: Python ----------
"""
Allows for the translation of GeoJSON data to Rhino objects

GeoJSON _does_ support 3d, so this can take 3d coordinates for 3d GeoJSONs

The GeoJSON Format Specification can be found here:
    http://geojson.org/geojson-spec.html

The RhinoCommon SDK (where all the Rhino.Geometry objects are documented) is
here:
    http://www.rhino3d.com/5/rhinocommon/

I have decided to extend the GeoJSON specification by adding support for one
more type of geometry that would be really useful in Rhino (and elsewhere),
the Mesh. Here is an example of a json Mesh:

    {"type": "Feature",
     "geometry": {
                  "type": "Mesh",
                  "coordinates": [
                                  [3.43, 54.234, 2343.23],
                                  [...],
                                  [...],
                                  ...,
                                  ]
                  "faces": [
                            [0,3,2],
                            [5,32,1],
                            ...,
                            ]
                  }
      "properties": {"prop0": "value0"}
      }


Example of Use:
    >>> import GeoJson2Rhino as geoj
    >>> myGeoJson = '''
{ "type": "FeatureCollection",
  "features": [
    { "type": "Feature",
      "geometry": {"type": "Point", "coordinates": [102.0, 0.5]},
      "properties": {"prop0": "value0"}
      },
    { "type": "Feature",
      "geometry": {
        "type": "LineString",
        "coordinates": [
          [102.0, 0.0], [103.0, 1.0], [104.0, 0.0], [105.0, 1.0]
          ]
        },
      "properties": {
        "prop0": "value0",
        "prop1": 0.0
        }
      },
    { "type": "Feature",
       "geometry": {
         "type": "Polygon",
         "coordinates": [
           [ [100.0, 0.0], [101.0, 0.0], [101.0, 1.0],
             [100.0, 1.0], [100.0, 0.0] ]
           ]
       },
       "properties": {
         "prop0": "value0",
         "prop1": {"this": "that"}
         }
       }
     ]
   }'''
   >>> guidList = geoj.load(myGeoJson) #stores guids of new rhino objects

"""

# Import standard library modules
import json
# Import Rhino modules
import Rhino
from Rhino.Geometry import *
from scriptcontext import doc

# import .NET libraries
import System
from System import Object
import rhinoscriptsyntax as rs
import sys
import os
import rhinoscriptsyntax as rs

# import GH dependencies
from clr import AddReference as addr
addr("Grasshopper")
from Grasshopper import DataTree
from Grasshopper.Kernel.Data import GH_Path

def addRhinoLayer(layerName, layerColor=System.Drawing.Color.Black):
    """Creates a Layer in Rhino using a name and optional color. Returns the
    index of the layer requested. If the layer
    already exists, the color is updated and no new layer is created."""
    docLyrs = doc.Layers
    layerIndex = docLyrs.Find(layerName, True)
    if layerIndex == -1:
        layerIndex = docLyrs.Add(layerName,layerColor)
    else: # it exists
        layer = docLyrs[layerIndex] # so get it
        if layer.Color != layerColor: # if it has a different color
            layer.Color = layerColor # reset the color
    return layerIndex

def PointToRhinoPoint(coordinates):
    if len(coordinates) > 2:
        z = coordinates[2]
    else:
        z = 0.0
    x, y = coordinates[0], coordinates[1]
    return Point3d(x, y, z)

def MultiPointToRhinoPoint(coordinates):
    rhPointList = []
    for point in coordinates:
        rhPointList.append(PointToRhinoPoint(point))
    return rhPointList

def MeshToRhinoMesh(coordinates, faces):
    rhMesh = Mesh()
    for point in coordinates:
        rhPoint = PointToRhinoPoint(point)
        rhMesh.Vertices.Add(rhPoint)
    for face in faces:
        i, j, k = tuple(face)
        mFace = MeshFace(i, j, k)
        rhMesh.Faces.AddFace(mFace)
    rhMesh.Normals.ComputeNormals()
    rhMesh.Compact()
    return rhMesh

def LineStringToRhinoCurve(coordinates):
    rhPoints = MultiPointToRhinoPoint(coordinates)
    return Curve.CreateControlPointCurve(rhPoints, 1)

def MultiLineStringToRhinoCurve(coordinates):
    rhCurveList = []
    for lineString in coordinates:
        rhCurveList.append(LineStringToRhinoCurve(lineString))
    return rhCurveList

def PolygonToRhinoCurve(coordinates):
    # each ring is a separate list of coordinates
    ringList = []
    for ring in coordinates:
        ringList.append(LineStringToRhinoCurve(ring))
    return ringList

def MultiPolygonToRhinoCurve(coordinates):
    polygonList = []
    for polygon in coordinates:
        polygonList.append(PolygonToRhinoCurve(polygon))
    return polygonList

def GeometryCollectionToParser(geometries):
    pass # I need to figure this one out still

def addPoint(rhPoint, objAtt):
    return doc.Objects.AddPoint(rhPoint, objAtt)

def addPoints(rhPoints, objAtt):
    guidList = []
    for rhPoint in rhPoints:
        guidList.append(doc.Objects.AddPoint(rhPoint, objAtt))
    return guidList

def addCurve(rhCurve, objAtt):
    return doc.Objects.AddCurve(rhCurve, objAtt)

def addCurves(rhCurves, objAtt):
    guidList = []
    for curve in rhCurves:
        guidList.append(addCurve(curve, objAtt))
    return guidList

def addPolygon(ringList, objAtt):
    # for now this just makes curves
    # but maybe it should make TrimmedSrfs
    # or should group the rings
    return addCurves(ringList, objAtt)

def addPolygons(polygonList, objAtt):
    guidList = []
    for polygon in polygonList:
        # !! Extending the guid list !!!
        guidList.extend(addPolygon(polygon, objAtt))
    return guidList

def addMesh(rhMesh, objAtt):
    return doc.Objects.AddMesh(rhMesh, objAtt)

geoJsonGeometryMap = {
        'Point':(PointToRhinoPoint, addPoint),
        'MultiPoint':(MultiPointToRhinoPoint, addPoints),
        'LineString':(LineStringToRhinoCurve, addCurve),
        'MultiLineString':(MultiLineStringToRhinoCurve, addCurves),
        'Polygon':(PolygonToRhinoCurve, addPolygon),
        'MultiPolygon':(MultiPolygonToRhinoCurve, addPolygons),
        'Mesh':(MeshToRhinoMesh, addMesh),
        'GeometryCollection':(GeometryCollectionToParser),
        }

def setUserKeys(properties, objAttributes):
    for key in properties:
        objAttributes.SetUserString(key, str(properties[key]))
    return objAttributes

def jsonToRhinoCommon(jsonFeature):
        # deal with the geometry
        geom = jsonFeature['geometry']
        geomType = geom['type'] # this will return a mappable string
        coordinates = geom['coordinates']
        # if this is a mesh, pass the faces
        if geomType == 'Mesh':
            faces = geom['faces']
            rhFeature = geoJsonGeometryMap[geomType][0](coordinates, faces)
        # translate the coordinates to Rhino.Geometry objects
        else:
            rhFeature = geoJsonGeometryMap[geomType][0](coordinates)
        return rhFeature

def addJsonFeature(jsonFeature, objAttributes):
        # deal with the properties
        if jsonFeature['properties']:
            objAttributes = setUserKeys(jsonFeature['properties'], objAttributes)
        geomType = jsonFeature['geometry']['type']
        rhFeature = jsonToRhinoCommon(jsonFeature)
        # return the GUID(s) for the feature
        return geoJsonGeometryMap[geomType][1](rhFeature, objAttributes)

def processGeoJson(parsedGeoJson,
         destinationLayer=None,
         destinationLayerColor=System.Drawing.Color.Black):
    # get the features
    jsonFeatures = parsedGeoJson['features']
    guidResults = []
    # set up object attributes
    for jsonFeature in jsonFeatures: # for each feature
        att = Rhino.DocObjects.ObjectAttributes()
        # setup layer if requested
        if destinationLayer != None:
            destinationLayer = None
            #att.LayerIndex = addRhinoLayer(destinationLayer,
                                           #destinationLayerColor)
        guidResults.append(addJsonFeature(jsonFeature, att))
    # return all the guids
    return guidResults
def load(rawJsonData,
         prefix=None,
         destinationLayer=None,
         destinationLayerColor=System.Drawing.Color.Black):
    # if the data already appears to be a dict literal ...
    if type(rawJsonData) == dict:
        jsonData = rawJsonData
    else: # otherwise, just try to load it
        jsonData = json.loads(rawJsonData)
    # if this is just a GeoJSON ...
    if jsonData["type"] == "FeatureCollection":
        # process the GeoJSON, pass the layer and color in
        return processGeoJson(jsonData, destinationLayer,
                              destinationLayerColor)
    # or if this is a set of layers from PostSites ...
    elif jsonData["type"] == "LayerCollection":
        # make a list for all the guids
        allResults = []
        layersList = jsonData['layers']
        for layer in layersList: # for each layer
            name = prefix + layer['name'] # get the name, modified to add filename to 
            if 'color' in layer: # get the color if it exists
                color = layer['color']
            else:
                color = destinationLayerColor # or just make it black
            geoJson = layer['contents'] # get the GeoJSON for this layer
            # make it
            layerResults = processGeoJson( geoJson, name, color )
            allResults.append(layerResults)
        return allResults, layersList
    else:
        return "This doesn't look like correctly formatted GeoJSON data.\nI'm not sure what to do with it, sorry."

idsOut = []
layerNamesOut = []
def getAttsVals(id,path=None):
    objct = doc.Objects.Find(id)
    data = objct.Attributes.GetUserStrings()
    d = {}
    k = []
    v = []
    if path==None:
        for u in sorted(data):
            k.append(u)
            print k
            d[u] = data[u]
            v.append(d[u])
        U = d
        Atts = k
        Vals = v
        return Atts,Vals
    if path:
        for u in data:
            k.append(u)
            d[u] = data[u]
            v.append(d[u])
            Attributes.Add(u,path)
            Values.Add(d[u],path)
        return None,None
    
def importSitefolder (filepath):
    f = str(SiteNumber)
    prefix = str(f +"_")
    try:
        f = open (filepath+"/"+f,'r')
    except:
        f = open (filepath+"/"+f+'.txt','r')
    myGeoJson = f.readline()
    guidList,layersList = load(myGeoJson, prefix)
    idsOut.append(guidList)
    layerNamesOut.append(layersList)
    f.close()

if Import!= None and type(Import) == bool:
    if Import == True:
        try:
            importSitefolder(geoJSONFolderPath)
            if guidList != None:
                message = 'You succesfully imported a geoJSON file!' 
            else:
                message = 'There was some problem with your geoJSON file, we imported as many layers as possible!'
                
        except:
            pass
else:
    print 'To Import you need to input a boolean toggle'

Geometry = DataTree[Object]()
Attributes = DataTree[Object]()
Values = DataTree[Object]()
LayerNames = DataTree[Object]()

### NOTE: some problems with mutlipolygons being nested 'up' a level. This problem is rooted in 'loader'
### it needs to be debugged out
for i in range (len(layerNamesOut[0])):
    p = GH_Path(i)
    LayerNames.Add(layerNamesOut[0][i]['name'],p)
    
for A in idsOut:#for each file
    for i in range (len(A)):# for each layer
        try:
            p = GH_Path(i)#make a new data tree path
            if (len(A[i])>1):# if the datatree path has more than one item
                for j in range (len(A[i])):# iterate
                    try:
                        thisId = A[i][j][0]
                        pPrime = p.AppendElement(j)
                        Geometry.Add(thisId,p)# add each feature to the path
                        getAttsVals(thisId,pPrime)
                    except:
                        ### It must be a point (tuple), cannot subscript it, grab it directly
                        try:
                            thisId = A[i][j]
                            pPrime = p.AppendElement(j)
                            Geometry.Add(thisId,p)
                            getAttsVals(thisId,pPrime)
                        except:
                            continue
            else:#otherwise, the layer has only one item (it is either a 1 item layer or a multipolygon)
                #it is a single object layer
                try:
                    thisId = A[i][0]
                    pPrime = p.AppendElement(0)
                    Geometry.Add(thisId,p)
                    getAttsVals(thisId,pPrime)
                except: #multipolygon is nested one level
                    print "Multipolygon found, some list-cleanup may be needed"
                    thisId = A[i][0][0]
                    pPrime = p.AppendElement(0)
                    Geometry.Add(thisId,p)
                    getAttsVals(thisId,pPrime)
        except:
            print 'There were some problems importing a layer, please try again with a different set of layers'
            continue
# ---------- end import_geojson ----------
number_slider_5 = Slider(3, range=0..10)  # disabled

# ---- group: stripe width - connected to print size
number_slider_6 = Slider(1, range=0..10)

# ----
unpickle_geometry = UnPickleGeometry(siteNumber=site_number, layer=panel, path=panel_2, read=toggle)  # -> out, simplify(geometry)
# ---------- unpickle_geometry: Python ----------
import cPickle as pickle

if path and read and layer:
    try:
        if siteNumber:
            f = open(path+str(int(siteNumber))+layer)
        else:
            f = open(path+layer)
        geometry = pickle.load(f)
        f.close()

    except:
        print 'problem loading %s\nfile may not exist' % path+str(int(siteNumber))+layer
# ---------- end unpickle_geometry ----------
panel_3 = Panel(item)
unpickle_view = UnpickleView(siteNumber=site_number, path=panel_2, UnPickle=toggle)  # -> out, geometry, vector, target
# ---------- unpickle_view: Python ----------
import os
import time

import Rhino
import cPickle as pickle
import rhinoscriptsyntax as rs
from scriptcontext import doc

if UnPickle:
    f = open(path + '%sview' % int(siteNumber), 'rb')
    view = pickle.load(f)
    f.close()
    if len(view) == 3:
        geometry = view[0]
        vector = Rhino.Geometry.Vector3d(view[1])
        target = view[2]
    else:
        print 'bad view data'
    
    vp = doc.Views.ActiveView.ActiveViewport
    vp.SetCameraDirection( vector, True)
    vp.SetCameraTarget(target, True)
    bb = geometry.GetBoundingBox(True)
    vp.ZoomBoundingBox( bb)
    doc.Views.ActiveView.Redraw()
    #return view
# ---------- end unpickle_view ----------
branch = TreeBranch(Tree=unpickle_geometry.geometry, Path=number_slider_2, MaintainPaths=True)
branch_2 = TreeBranch(Tree=unpickle_geometry.geometry, Path=Slider(1, range=0..100), MaintainPaths=True)
branch_3 = TreeBranch(Tree=unpickle_geometry.geometry, Path=Slider(0, range=0..100), MaintainPaths=True)
branch_4 = TreeBranch(Tree=unpickle_geometry.geometry, Path=Slider(4, range=0..100), MaintainPaths=True)

# ---- group: hardscape mesh
geo = Geometry(branch_2)

geo_2 = Geometry(simplify(geo))

# ---- group: Drainarea Mesh
geo_3 = Geometry(branch_3)

# ---- group: Terrain Mesh
geo_4 = Geometry(branch_4)

geo_5 = Geometry(geo_4)  # disabled

# ----
geo_6 = Geometry(import_geojson.Geometry)
panel_4 = Panel(branch)

# ---- group: Drainarea Mesh
geo_7 = Geometry(geo_3)

# ----
division_2 = Division(A=number_slider_6, B=Slider(3, range=0..10))
neg_3 = Negative(Value=division_2)

# ---- group: turn meshes into curved outlines
faceb = FaceBoundaries(Mesh=geo_2)
project = Project(Geometry=faceb, Plane=PlaneXY(0, 0, 0))  # -> Geometry, Transform

# ---- group: turn meshes into curved outlines / hardscape areas on XY plane
runion = RegionUnion(Curves=project.Geometry)

# ---- group: turn meshes into curved outlines (continued)
fillet = Fillet(Curve=runion, Radius=Slider(6, range=0..10))
area = Area(Geometry=fillet)  # -> Area, Centroid
crv_cp = CurveClosestPoint(Point=area.Centroid, Curve=fillet)  # -> Point, Parameter, Distance
dist = Distance(PointA=area.Centroid, PointB=crv_cp.Point)
offset = Offset(Curve=fillet, Distance=1, Plane=PlaneXY(0, 0, 0), Corners=1)

# ---- group: approximate radius
num = Number(simplify(dist))

num_2 = Number(simplify(num))  # disabled

# ----
division_3 = Division(A=num_2, B=number_slider)  # disabled
expression = Expression(x=division_3, Expression="floor(x)")  # disabled
series = Series(Start=0, Step=neg, Count=expression)  # -> simplify(Series); disabled

# ---- group: hardscape curves
crv = Curve(simplify(fillet))

crv_2 = Curve(simplify(crv))

crv_3 = Curve(simplify(crv))  # disabled

# ----
len = Length(Curve=crv_2)
integer_division = IntegerDivision(A=len, B=Slider(2, range=0..10))

# ---- group: rebuilt curves
reb = RebuildCurve(Curve=crv_2, Count=integer_division, Tangents=False)

# ----
area_2 = Area(Geometry=reb)  # -> Area, Centroid
offset_2 = Offset(Curve=crv_3, Distance=series, Plane=PlaneXY(0, 0, 0), Corners=1)  # -> simplify(Curve); disabled
crv_cp_2 = CurveClosestPoint(Point=area_2.Centroid, Curve=reb)  # -> Point, Parameter, Distance
cls = Closed(Curve=offset_2)  # -> Closed, Periodic; disabled
integer_division_2 = IntegerDivision(A=crv_cp_2.Distance, B=number_slider_6)
dispatch = Dispatch(List=offset_2, DispatchPattern=cls.Closed)  # -> ListA, ListB; disabled
round = Round(Number=integer_division_2)  # -> Nearest, Floor, Ceiling
offset_3 = Offset(Curve=dispatch.ListA, Distance=neg_2, Plane=PlaneXY(0, 0, 0), Corners=number_slider_5)  # -> simplify(Curve); disabled
rulesrf = RuledSurface(CurveA=dispatch.ListA, CurveB=offset_3)  # disabled
series_2 = Series(Start=0, Step=number_slider_6, Count=round.Floor)  # -> simplify(Series)
neg_4 = Negative(Value=series_2)
panel_5 = Panel(neg_4)

# ---- group: base of circles
offset_4 = Offset(Curve=reb, Distance=neg_4, Plane=PlaneXY(0, 0, 0), Corners=Slider(2, range=0..10))

# ----
offset_5 = Offset(Curve=offset_4, Distance=neg_3, Plane=PlaneXY(0, 0, 0), Corners=1)
rulesrf_2 = RuledSurface(CurveA=offset_4, CurveB=offset_5)
