# Grasshopper definition 02C-Wide Flowlines B.gh (Grasshopper 0.9.76)
# plug-ins: Python Interpreter

panel = Panel("""Linework_InterventionOutlines
Linework_Drainage_Lines_Site""")
number_slider = Slider(11, range=1..1374)
panel_2 = Panel("F:\Local Code\Work\Local Code - San Francisco\06 DB\Pickles\")
write_pickles = Panel("C:\Users\Carlos Emilio\Desktop\06 DB\Pickles\")
mindex = MemberIndex(Set=panel, Member="Linework_Drainage_Lines_Site")  # -> Index, Count
# NEED TO ADD SCALE TO FLOWLINE WIDTH
panel_3 = Panel("1374")
mindex_2 = MemberIndex(Set=panel, Member="Linework_InterventionOutlines")  # -> Index, Count
path = ConstructPath(Indices=mindex.Index)
unpickle_geometry = UnPickleGeometry(siteNumber=number_slider, layer="Data_CNN", path=panel_2, read=panel_2)  # -> out, geometry
# ---------- unpickle_geometry: Python ----------
import cPickle as pickle

if path and read and layer:
    try:
        if siteNumber:
            f = open(path+str(int(siteNumber))+layer)
        else:
            f = open(path+layer)
        geometry = pickle.load(f)
        f.close()

    except:
        print 'problem loading %s\nfile may not exist' % path+str(int(siteNumber))+layer
# ---------- end unpickle_geometry ----------
path_2 = ConstructPath(Indices=mindex_2.Index)
unpickle_geometry_2 = UnPickleGeometry(siteNumber=number_slider, layer=panel, path=panel_2, read=Toggle(True))  # -> out, simplify(geometry); same code as unpickle_geometry
geo = Geometry(unpickle_geometry_2.geometry)
geo_2 = Geometry(unpickle_geometry_2.geometry)
branch = TreeBranch(Tree=geo, Path=path, MaintainPaths=True)
branch_2 = TreeBranch(Tree=geo_2, Path=path_2, MaintainPaths=True)

# ---- group: flowlines-curves
geo_3 = Geometry(branch)

# ----
viewer = ParamViewer(unpickle_geometry_2.geometry)

# ---- group: Find Printed Width in MM from Excel File Generated by Catalogtree
panel_4 = Panel("C:\Users\Carlos Emilio\Documents\Github\SF-grasshopper\Filename and Funding Only_result.csv")
file = ReadFile(File=panel_4, PerLineParse=True)
split = TextSplit(Text=file, Separators=",")
item = ListItem(List=split, Index=Slider(8, range=0..10), Wrap=True)  # -> flatten(Item)
item_2 = ListItem(List=split, Index=Slider(2, range=0..10), Wrap=True)  # -> flatten(Item)
mindex_3 = MemberIndex(Set=item_2, Member=unpickle_geometry.geometry)  # -> Index, Count
item_3 = ListItem(List=item, Index=mindex_3.Index, Wrap=True)

# ---- group: flowlines-curves
geo_4 = Geometry(geo_3)

# ----
len = Length(Curve=geo_4)
sort = SortList(Keys=len, ValuesA=geo_4)  # -> Keys, ValuesA

# ---- group: sorted flowline curves
geo_5 = Geometry(sort.ValuesA)

# ---- group: intervention outline
geo_6 = Geometry(branch_2)

# ----
wideyness = Slider(1.2, range=0..10)
end = EndPoints(Curve=geo_5)  # -> Start, End
item_4 = ListItem(List=reverse(flatten(sort.Keys)), Index=0, Wrap=True)

# ---- group: line starts
geo_7 = Geometry(end.Start)

# ----
crv_cp = CurveClosestPoint(Point=graft(geo_7), Curve=geo_6)  # -> Point, Parameter, Distance

# ---- group: curves
lng = ListLength(List=flatten(geo_7))
repeat = RepeatData(Data=graft(geo_6), Length=lng)
flip = FlipMatrix(Data=simplify(repeat))
sort_2 = SortList(Keys=crv_cp.Distance, ValuesA=flip)  # -> Keys, ValuesA
item_5 = ListItem(List=sort_2.ValuesA, Index=0, Wrap=True)

# ---- group: Re-scale Width Non-linearly
split_2 = SplitList(List=item, Index=Slider(1, range=0..10))  # -> ListA, ListB
bnd = Bounds(Numbers=split_2.ListB)
remap = RemapNumbers(Value=split_2.ListB, Source=bnd, Target=Domain(0, 1))  # -> Mapped, Clipped
graph = GraphMapper(
    remap.Clipped,
    x0=0,
    x1=1,
    y0=0,
    y1=1,
    container_name="Bezier",
    cpx=[0, 0, 0.5319381952, 1],
    cpy=[0, 0.6676520705, 0.7911244631, 1])
dom = ConstructDomain(DomainStart=Slider(1.1, range=0..10), DomainEnd=Slider(10, range=0..10))
bnd_2 = Bounds(Numbers=split_2.ListB)
subtraction = Subtraction(A=mindex_3.Index, B="1")
remap_2 = RemapNumbers(Value=graph, Source=Domain(0, 1), Target=dom)  # -> Mapped, Clipped
item_6 = ListItem(List=remap_2.Mapped, Index=subtraction, Wrap=True)

# ----
remap_3 = RemapNumbers(Value=sort.Keys, Source=item_4, Target=item_6)  # -> simplify(graft(Mapped)), Clipped

# ---- group: parameters
sort_3 = SortList(Keys=crv_cp.Distance, ValuesA=crv_cp.Parameter)  # -> Keys, ValuesA
item_7 = ListItem(List=sort_3.ValuesA, Index=0, Wrap=True)

# ---- group: points
sort_4 = SortList(Keys=crv_cp.Distance, ValuesA=crv_cp.Point)  # -> Keys, ValuesA
item_8 = ListItem(List=sort_4.ValuesA, Index=0, Wrap=True)

# ----
addition = Addition(A=simplify(item_7), B=simplify(remap_3.Mapped))
subtraction_2 = Subtraction(A=graft(item_7), B=simplify(remap_3.Mapped))
dom_2 = ConstructDomain(DomainStart=subtraction_2, DomainEnd=addition)
eval = EvaluateCurve(Curve=simplify(item_5), Parameter=simplify(addition))  # -> Point, Tangent, Angle
eval_2 = EvaluateCurve(Curve=simplify(item_5), Parameter=simplify(subtraction_2))  # -> Point, Tangent, Angle

# ---- group: sorted flowline curves
geo_8 = Geometry(geo_5)

# ----
vec2pt = Vector2Pt(PointA=graft(geo_7), PointB=eval.Point, Unitize=False)  # -> Vector, Length
vec2pt_2 = Vector2Pt(PointA=graft(geo_7), PointB=eval_2.Point, Unitize=False)  # -> Vector, Length
cp = ControlPoints(Curve=geo_8)  # -> Points, Weights, Knots
panel_5 = Panel(item_3)
panel_6 = Panel(item_6)

# ---- group: only keep the arrows of the top 15% in size / Find Printed Width in MM from Excel File Generated by Catalogtree
panel_7 = Panel("C:\Users\Carlos Emilio\Documents\Github\SF-grasshopper\Filename and Funding Only_result.csv")
file_2 = ReadFile(File=panel_7, PerLineParse=True)
split_3 = TextSplit(Text=file_2, Separators=",")
item_9 = ListItem(List=split_3, Index=Slider(8, range=0..10), Wrap=True)  # -> flatten(Item)
item_10 = ListItem(List=split_3, Index=Slider(2, range=0..10), Wrap=True)  # -> flatten(Item)
mindex_4 = MemberIndex(Set=item_10, Member=unpickle_geometry.geometry)  # -> Index, Count
item_11 = ListItem(List=item_9, Index=mindex_4.Index, Wrap=True)

# ----
lng_2 = ListLength(List=cp.Points)
range = Range(Domain=Domain(0, 1), Steps=lng_2)
multiplication = Multiplication(A=vec2pt.Vector, B=range)  # -> reverse(simplify(Result))
multiplication_2 = Multiplication(A=vec2pt_2.Vector, B=range)  # -> reverse(simplify(Result))
pt = Point(cp.Points)
move = Move(Geometry=simplify(pt), Motion=multiplication)  # -> Geometry, Transform
move_2 = Move(Geometry=simplify(pt), Motion=multiplication_2)  # -> Geometry, Transform

# ---- group: only keep the arrows of the top 15% in size
sort_5 = SortList(Keys=item_9)  # -> Keys, ValuesA
lng_3 = ListLength(List=sort_5.Keys)
multiplication_3 = Multiplication(A=lng_3, B=Slider(0.85, range=0..1))
item_12 = ListItem(List=sort_5.Keys, Index=multiplication_3, Wrap=True)
larger = LargerThan(FirstNumber=item_11, SecondNumber=item_12)  # -> LargerThan, OrEqualTo
filter = StreamFilter(Gate=larger.OrEqualTo)

# ----
subcrv = SubCurve(BaseCurve=simplify(item_5), Domain=simplify(dom_2))
intcrv = Interpolate(Vertices=move_2.Geometry, Degree=3, Periodic=False, KnotStyle=1)  # -> Curve, Length, Domain
intcrv_2 = Interpolate(Vertices=move.Geometry, Degree=3, Periodic=False, KnotStyle=1)  # -> Curve, Length, Domain
merge = Merge(Data1=intcrv_2.Curve, Data2=intcrv.Curve, Data3=subcrv)

# ---- group: extruded traces
join = JoinCurves(Curves=merge, Preserve=False)

# ---- group: drainage lines from outline
geo_9 = Geometry(join)

# ---- group: subtract flow lines from site geometry
project = Project(Geometry=geo_6, Plane=PlaneXY(0, 0, 0))  # -> Geometry, Transform
project_2 = Project(Geometry=geo_9, Plane=PlaneXY(0, 0, 0))  # -> Geometry, Transform
rdiff = RegionDifference(CurvesA=flatten(project_2.Geometry), CurvesB=flatten(project.Geometry))
filter_2 = StreamFilter(Gate=larger.OrEqualTo, Stream0=rdiff, Stream1=geo_9)

# ----
pickler = Pickler(
    data=flatten(filter_2),
    siteNumber=number_slider,
    layer="Linework_Wide_Drainage_Lines_Site",
    path=write_pickles,
    write=Toggle(True))  # -> out, geometry; inputs data: list of GeometryBase
# ---------- pickler: Python ----------
import cPickle as pickle

if path and data and write:
    if siteNumber:
        f = open(path+str(int(siteNumber))+layer, 'wb')
    else:
        f = open(path+layer, 'wb')
    pickle.dump(data, f)
    f.close()
    fcheck = open(path+str(int(siteNumber))+layer)
    geometry = pickle.load(fcheck)
    fcheck.close()
# ---------- end pickler ----------
